# Grasshopper definition compas_ghc_test.gh (Grasshopper 0.9.76)
# plug-ins: Python Interpreter

python = PythonScript()  # -> a
# ---------- python: Python ----------
from compas_ghc.test import testImportFunc

a = testImportFunc()
# ---------- end python ----------
panel = Panel(python)
